# Dynamo graph India-Rails.dyn (Dynamo 1.0.0.1431)

file_path = Filename("Data\IND_rails\IND_rails.shp")
loadFromFile = EGIS.DynamoLib.Shape.LoadFromFile(file_path)
getAllShapes = EGIS.DynamoLib.Shape.GetAllShapes(loadFromFile)
count = Count(getAllShapes)
watch = Watch(count)
getAllShapesInAllRecords = EGIS.DynamoLib.Shape.GetAllShapesInAllRecords(loadFromFile)
count_2 = Count(getAllShapesInAllRecords)
watch_2 = Watch(count_2)
recordCount = EGIS.DynamoLib.Shape.RecordCount(loadFromFile)
watch_3 = Watch(recordCount)
